# Dynamo graph 21_0513 Cut Length Optimization.dyn (Dynamo 2.6.1.8786)
# packages: BIM4Struc.Productivity 2.2.2

# group: Structural Framing Family Type
family_types = FamilyTypes("Trus_Joist-Weyerhaeuser-TJI:TJI® 230 joist - 14")

# group: Extract Length, Round up to even FT
all_elements_of_family_type = ElementsOfFamilyType(Family_Type=family_types)
code_block = CodeBlock { "Length"; }
getParameterValueByName = Element.GetParameterValueByName(element=all_elements_of_family_type, parameterName=code_block)
ceiling = Math.Ceiling(number=getParameterValueByName)
sort = List.Sort(list=ceiling)
maximumItem = List.MaximumItem(list=sort)

# group: Longest Required Beam
watch = Watch(maximumItem)

# group: Max. Stock Length
code_block_2 = CodeBlock { 60; }

# group: Stock Length Range
code_block_3 = CodeBlock()
# ---------- code_block_3.designscript (3 lines) ----------
//Stock Length
//Step Size
0.5;
# ----------------------------------------
range = Range(start=watch, end=code_block_2, step=code_block_3)

# group: Bin Packing
first_fit_decreasing_bin_packing = Custom[First Fit Decreasing Bin Packing](Values=sort, BinSize=range)  # package BIM4Struc.Productivity; Groups a list of numeric values in bins according to the First Fit Decreasing algorithm based on a maximum cumulative value. This method can be used to optimize the planning of cut lengths of linear elements. The IndicesPerBin refer to the indices of the decreasing sorted value list, ordered per bin.
watch_2 = Watch(first_fit_decreasing_bin_packing.BinPackingResult)
watch_3 = Watch(first_fit_decreasing_bin_packing.Waste)

# group: Optimize Waste by Stock Length
sum = Math.Sum(values=watch_3)
sortIndexByValue = List.SortIndexByValue(list=sum)
firstItem = List.FirstItem(list=sortIndexByValue)

# group: QTY Beams @ Optimized Length
getItemAtIndex = List.GetItemAtIndex(list=watch_2, index=firstItem)
count = List.Count(list=getItemAtIndex)
watch_4 = Watch(count)

# group: Optimized Stock Length
getItemAtIndex_2 = List.GetItemAtIndex(list=range, index=firstItem)
watch_5 = Watch(getItemAtIndex_2)

# group: Total LF
mul = count * watch_5
watch_6 = Watch(mul)

# group: Total Wastage (LF)
getItemAtIndex_3 = List.GetItemAtIndex(list=sum, index=firstItem)
watch_7 = Watch(getItemAtIndex_3)

# group: User Override Stock Length
code_block_4 = CodeBlock()
# ---------- code_block_4.designscript (2 lines) ----------
//Stock Length User Input
24;
# ----------------------------------------
first_fit_decreasing_bin_packing_2 = Custom[First Fit Decreasing Bin Packing](Values=sort, BinSize=code_block_4)

# group: Total Wastage (LF)w/ User Override
sum_2 = Math.Sum(values=first_fit_decreasing_bin_packing_2.Waste)
watch_8 = Watch(sum_2)

# group: QTY Beams @ User Input Length
count_2 = List.Count(list=first_fit_decreasing_bin_packing_2.BinPackingResult)
watch_9 = Watch(count_2)

# group: Total LF to Purchase w/ User Override
mul_2 = watch_9 * code_block_4
watch_10 = Watch(mul_2)
